# Grasshopper definition cone_to_creal_yarn_model.gh (Grasshopper 1.0.8)

# ---- group: Circle Setup
pt = Point(Point(0, 0, 0))
division = Division(A=Slider(100, range=0..200), B=2)
cir = Circle(Plane=pt, Radius=division)

# ---- group: Point Above
Z = UnitZ(Factor=Slider(100, range=0..100))
move = Move(Geometry=pt, Motion=Z)  # -> Geometry, Transform

# ---- group: Line Setup
Z_2 = UnitZ(Factor=1)
Z_3 = UnitZ(Factor=Slider(79, range=0..100))
move_2 = Move(Geometry=pt, Motion=Z_3)  # -> Geometry, Transform
line = LineSDL(Start=move_2.Geometry, Direction=Z_2, Length=20)

# ---- group: Rim Point
eval = EvaluateCurve(Curve=reparameterize(cir), Parameter=Slider(0.099, range=0..1))  # -> Point, Tangent, Angle

# ---- group: Connecting Curve
biarc = BiArc(
    StartPoint=eval.Point,
    StartTangent=eval.Tangent,
    EndPoint=move_2.Geometry,
    EndTangent=Z_2,
    Ratio=Slider(0.439, range=0..1))  # -> FirstArc, SecondArc, BiArc
