# Grasshopper definition grasshopper_to_place_cone.gh (Grasshopper 1.0.8)

number_slider = Slider(44.6, range=0..1000)
brep = Brep(<brep referenced from the Rhino model>)
pt = Point(Point(0, 0, 0))
number_slider_2 = Slider(150, range=0..5000)
number_slider_3 = Slider(406.4, range=0..1000)
number_slider_4 = Slider(6, range=1..50)
number_slider_5 = Slider(339.6, range=0..1000)
number_slider_6 = Slider(2679.7, range=0..5000)
pt_2 = Point(Point(2409.247621, 1159.851361, 1369.105749))
pt_3 = Point(Point(2409.247621, 943.7312349, 2083.044141))
toggle = BooleanToggle(False)
number_slider_7 = Slider(8, range=0..100)
number_slider_8 = Slider(4, range=1..50)
pt_4 = Point(Point(2658.44867, 975.3163464, 1555.577932))
yarn_radius = Slider(1, range=0..5)
pt_5 = Point(Point(2880.910316, 975.3163464, 1555.577932))
pt_6 = Point(Point(2934.405819, 1218.210956, 2033.903443))
pt_7 = Point(Point(2934.405819, 2258.685291, 2033.903443))
pt_8 = Point(Point(2934.405819, 1218.210956, 2033.903443))
pt_9 = Point(Point(3091.937875, 1223.763175, 2033.903443))
division = Division(A=number_slider_5, B="2")
pt_10 = Point(Point(3279.61159, 943.7312349, 2.058135835))
pt_11 = Point(Point(2934.405819, 3753.066381, 2033.903443))
pt_12 = Point(Point(3076.70422, 3737.626507, 2033.903443))
pt_13 = Point(Point(2658.44867, 3929.71677, 1555.577932))
pt_14 = Point(Point(2880.910316, 3951.765053, 1555.577932))
pt_15 = Point(Point(2934.405819, 3753.066381, 2033.903443))
pt_16 = Point(Point(2934.405819, 2708.838534, 2033.903443))
merge = Merge(
    Data1=yarn_radius,
    Data2=pt_4,
    Data3=pt_5,
    Data4=pt_6,
    Data5=pt_7,
    Data6=pt_8,
    Data7=pt_9,
    Data8=number_slider_7,
    Data9=toggle,
    Data10=pt_13,
    Data11=pt_13,
    Data12=pt_14,
    Data13=pt_15,
    Data14=pt_16,
    Data15=pt_11,
    Data16=pt_12)
cluster = Cluster(
    relay_2=number_slider_3,
    Y=number_slider_6,
    N=number_slider_5,
    C=number_slider_4,
    relay_3=number_slider_2,
    B_2=division,
    G=brep,
    A=pt,
    relay=number_slider,
    B=pt_3)  # -> L, out_cone_centroid_bottoms, out_cones, out_rectangle
cluster_2 = Cluster(
    relay_2=number_slider_3,
    Y=number_slider_6,
    N=number_slider_5,
    C=number_slider_4,
    relay_3=number_slider_2,
    B_2=division,
    G=brep,
    A=pt,
    relay=number_slider,
    B=pt_2)  # -> L, out_cone_centroid_bottoms, out_cones, out_rectangle
merge_2 = Merge(
    Data1=number_slider_3,
    Data2=number_slider_4,
    Data3=number_slider_6,
    Data4=number_slider_6,
    Data5=number_slider_2,
    Data6=number_slider,
    Data7=number_slider_8,
    Data8=merge)
cluster_3 = Cluster(
    relay_2=number_slider_3,
    Y=number_slider_6,
    N=number_slider_5,
    C=number_slider_8,
    relay_3=number_slider_2,
    B_2=division,
    G=brep,
    A=pt,
    relay=number_slider,
    B=pt_10)  # -> L, out_cone_centroid_bottoms, out_cones, out_rectangle
cluster_4 = Cluster_3(C=brep)
subtraction = Subtraction(A=cluster_4, B="7")
addition = Addition(A="42", B="1")
vec = VectorXYZ(XComponent="0", YComponent="0", ZComponent=subtraction)  # -> Vector, Length
addition_2 = Addition(A=addition, B="1")
move = Move(Geometry=cluster_2.out_cone_centroid_bottoms, Motion=vec.Vector)  # -> Geometry, Transform
random = Random(Range=Domain(0, 1), Number=cluster_2.L, Seed=addition_2)
cluster_5 = Cluster_4(start_line_1=pt_4, B=pt_5, A=pt_6, B_2=pt_7, N=number_slider_7)
random_2 = Random(Range=Domain(0, 1), Number=cluster_2.L, Seed=addition)
cluster_6 = Cluster_4(start_line_1=pt_8, B=pt_9, A=pt_6, B_2=pt_7, N=number_slider_7)
py3 = Python3Script(seed="42", count=cluster_2.L)  # -> flatten(a)
# ---------- py3: Python ----------
import random

# Inputs: count (integer), seed (integer)

random.seed(seed)
a = [random.choice([True, False]) for _ in range(count)]
# ---------- end py3 ----------
cluster_7 = Cluster_4(start_line_1=pt_13, B=pt_14, A=pt_15, B_2=pt_16, N=number_slider_7)
cluster_8 = Cluster_4(start_line_1=pt_4, B=pt_5, A=pt_8, B_2=pt_9, N=number_slider_7)
panel = Panel(cluster_2.L)
panel_2 = Panel(cluster.L)
panel_3 = Panel(cluster_3.L)
cluster_9 = Cluster_4(start_line_1=pt_11, B=pt_12, A=pt_15, B_2=pt_16, N=number_slider_7)
cluster_10 = Cluster_4(start_line_1=pt_13, B=pt_14, A=pt_11, B_2=pt_12, N=number_slider_7)
panel_4 = Panel(cluster_3.out_cones)
merge_3 = Merge(Data1=cluster_8, Data2=cluster_6)
addition_3 = Addition(A=cluster_2.L, B=cluster.L, C=cluster_3.L)
merge_4 = Merge(Data1=cluster_10, Data2=cluster_9)
merge_5 = Merge(Data1=cluster_5, Data2=cluster_7)  # -> flatten(Result)
merge_6 = Merge(Data1=merge_3, Data2=merge_4)
panel_5 = Panel(addition_3)
filter = StreamFilter(Gate=toggle, Stream0=merge_5, Stream1=merge_6)  # -> flatten(Stream)
cluster_11 = Cluster_2(
    A=Slider(480, range=0..1000),
    B=random,
    P=move.Geometry,
    A_2=Slider(173.8, range=0..200),
    t=random_2,
    D=Slider(0, range=0..90),
    panel_3=py3,
    R=Slider(0.412, range=0..1))  # -> flatten(R_2)
merge_7 = Merge(Data1=cluster_11, Data2=filter)
pipe = Pipe(Curve=merge_7, Radius=yarn_radius, Caps="1", FitRail=False)
merge_8 = Merge(Data1=cluster_2.out_cones, Data2=cluster.out_cones, Data3=cluster_3.out_cones, Data4=pipe)  # -> flatten(Result)
mesh = MeshBrep(
    Brep=merge_8,
    Settings={GridMaxCount=0, GridMinCount=16, JaggedSeams=False, MaxEdgeLength=0, MinEdgeLength=50, MinTolerance=0, Refine=True, RefineAngle=0, RelativeTolerance=0.65, SimplePlanes=True, Tolerance=0})
flatten = FlattenTree(Tree=mesh, Path="{0}")
py3_2 = Python3Script(geometry=flatten(flatten), trigger=merge_2)  # -> out, a; inputs geometry: tree
# ---------- py3_2: Python ----------
from Grasshopper import DataTree
import Rhino
import Rhino.Geometry as rg
import scriptcontext as sc
import System
import struct
import os
import sys

# Get all items from tree
geo_list = []
if hasattr(geometry, 'Branches'):
    for branch in geometry.Branches:
        for item in branch:
            geo_list.append(item)

# Skip if nothing changed
geo_count = len(geo_list)
last_count = sc.sticky.get("last_geo_count", -1)
if geo_count == last_count:
    a = sc.sticky.get("last_stl_path", "")
    print("No change, skipping export")
else:
    sc.sticky["last_geo_count"] = geo_count

    # Build combined mesh
    stl_path = "C:/temp/cones.stl"
    mesh_list = rg.Mesh()

    for geo in geo_list:
        if isinstance(geo, rg.Mesh):
            geo.Faces.ConvertQuadsToTriangles()
            mesh_list.Append(geo)
        elif isinstance(geo, rg.Brep):
            meshes = rg.Mesh.CreateFromBrep(geo, rg.MeshingParameters.Coarse)
            if meshes:
                for m in meshes:
                    m.Faces.ConvertQuadsToTriangles()
                    mesh_list.Append(m)
        elif isinstance(geo, System.Guid):
            rhino_obj = sc.doc.Objects.FindId(geo)
            if rhino_obj:
                obj_geo = rhino_obj.Geometry
                if isinstance(obj_geo, rg.Mesh):
                    obj_geo.Faces.ConvertQuadsToTriangles()
                    mesh_list.Append(obj_geo)
                elif isinstance(obj_geo, rg.Brep):
                    meshes = rg.Mesh.CreateFromBrep(obj_geo, rg.MeshingParameters.Coarse)
                    if meshes:
                        for m in meshes:
                            m.Faces.ConvertQuadsToTriangles()
                            mesh_list.Append(m)

    # Build triangle list
    mesh_list.Faces.ConvertQuadsToTriangles()
    triangles = []
    for i in range(mesh_list.Faces.Count):
        face = mesh_list.Faces[i]
        v0 = mesh_list.Vertices[face.A]
        v1 = mesh_list.Vertices[face.B]
        v2 = mesh_list.Vertices[face.C]
        triangles.append((v0, v1, v2))

    # Write STL
    os.makedirs(os.path.dirname(stl_path), exist_ok=True)
    with open(stl_path, 'wb') as f:
        f.write(b'\0' * 80)
        f.write(struct.pack('<I', len(triangles)))
        for v0, v1, v2 in triangles:
            f.write(struct.pack('<fff', 0, 0, 0))
            f.write(struct.pack('<fff', v0.X, v0.Y, v0.Z))
            f.write(struct.pack('<fff', v1.X, v1.Y, v1.Z))
            f.write(struct.pack('<fff', v2.X, v2.Y, v2.Z))
            f.write(struct.pack('<H', 0))

    print(f"Exported {len(geo_list)} objects ({len(triangles)} triangles) to {stl_path}")

    # Send to RoboDK
    try:
        sys.path.append("C:/RoboDK/Python")
        from robodk.robolink import Robolink

        RDK = Robolink()

        # Remove previous object if it exists
        prev = RDK.Item("cones")
        if prev.Valid():
            prev.Delete()

        # Load new STL
        RDK.AddFile(stl_path)
        print("Loaded into RoboDK")
    except Exception as e:
        print(f"RoboDK error: {e}")

    sc.sticky["last_stl_path"] = stl_path
    a = stl_path
# ---------- end py3_2 ----------

# ==== cluster Cluster
relay = ClusterInput()
relay_2 = ClusterInput()
relay_3 = ClusterInput()
A = ClusterInput()
B = ClusterInput()
N = ClusterInput()
C = ClusterInput()
B_2 = ClusterInput()
Y = ClusterInput()
vec2pt = Vector2Pt(PointA=A, PointB=B, Unitize=False)  # -> Vector, Length
series = Series(Start=0, Step=N, Count=C)
pt = ConstructPoint(XCoordinate=relay, YCoordinate=relay_3, ZCoordinate=0)
subtraction = Subtraction(A=relay_2, B=relay)
addition = Addition(A=relay_3, B=B_2)
rectangle = Rectangle(Plane=PlaneXY(0, 0, 0), XSize=relay_2, YSize=Y, Radius=0)  # -> Rectangle, Length
pt_2 = ConstructPoint(XCoordinate=subtraction, YCoordinate=addition, ZCoordinate=0)
Y_2 = UnitY(Factor=series)
move = Move(Geometry=rectangle.Rectangle, Motion=vec2pt.Vector)  # -> Geometry, Transform
merge = Merge(Data1=pt, Data2=pt_2)
move_2 = Move(Geometry=graft(merge), Motion=Y_2)  # -> Geometry, Transform
G = ClusterInput()
move_3 = Move(Geometry=move_2.Geometry, Motion=vec2pt.Vector)  # -> flatten(Geometry), Transform
move_4 = Move(Geometry=G, Motion=move_3.Geometry)  # -> Geometry, Transform
lng = ListLength(List=flatten(move_4.Geometry))
L = ClusterOutput(lng)
out_rectangle = ClusterOutput(move.Geometry)
out_cone_centroid_bottoms = ClusterOutput(move_3.Geometry)
out_cones = ClusterOutput(move_4.Geometry)

# ==== cluster Cluster_2
A = ClusterInput()
A_2 = ClusterInput()
B = ClusterInput()
P = ClusterInput()
t = ClusterInput()
division = Division(A=A_2, B=2)
D = ClusterInput()
multiplication = Multiplication(A=A, B=B)
cir = Circle(Plane=P, Radius=division)
rad = Radians(Degrees=D)
subtraction = Subtraction(A=A, B=multiplication)
R = ClusterInput()
Z = UnitZ(Factor=1)
Z_2 = UnitZ(Factor=subtraction)
eval = EvaluateCurve(Curve=reparameterize(cir), Parameter=t)  # -> Point, Tangent, Angle
move = Move(Geometry=P, Motion=Z_2)  # -> Geometry, Transform
vec2pt = Vector2Pt(PointA=move.Geometry, PointB=eval.Point, Unitize=False)  # -> Vector, Length
neg = Negative(Value=eval.Tangent)
filter = StreamFilter(Gate=Toggle(True), Stream0=eval.Tangent, Stream1=neg)
line = LineSDL(Start=move.Geometry, Direction=Z, Length=multiplication)
xprod = CrossProduct(VectorA=vec2pt.Vector, VectorB=Z, Unitize=False)  # -> Vector, Length
vrot = Rotate(Vector=Z, Axis=xprod.Vector, Angle=rad)
end = EndPoints(Curve=line)  # -> Start, End
biarc = BiArc(StartPoint=eval.Point, StartTangent=filter, EndPoint=move.Geometry, EndTangent=vrot, Ratio=R)  # -> FirstArc, SecondArc, flatten(BiArc)
weave = Weave(Pattern=[0, 1], Stream0=line, Stream1=biarc.BiArc, NullGaps=False)  # -> flatten(Weave)
partition = PartitionList(List=weave, Size="2")
panel = Panel(partition)
panel_2 = Panel(biarc.BiArc)
ln = Line(StartPoint=eval.Point, EndPoint=end.End)
join = JoinCurves(Curves=partition, Preserve=False)  # -> flatten(Curves)
panel_3 = ClusterInput()
panel_4 = Panel(ln)
p_n_c = PickNChoose(Pattern=panel_3, Stream0=ln, Stream1=join)
panel_5 = Panel(panel_3)
panel_6 = Panel(p_n_c)
R_2 = ClusterOutput(p_n_c)
panel_7 = Panel(join)

# ==== cluster Cluster_3
C = ClusterInput()
bbox = BoundingBox(Content=C, Plane=PlaneXY(0, 0, 0))  # -> Box, Box_2
debox = DeconstructBox(Box=bbox.Box)  # -> Plane, X, Y, Z
dedomain = DeconstructDomain(Domain=debox.Z)  # -> Start, End
subtraction = Subtraction(A=dedomain.End, B=dedomain.Start)
R = ClusterOutput(subtraction)

# ==== cluster Cluster_4
start_line_1 = ClusterInput()
B = ClusterInput()
A = ClusterInput()
B_2 = ClusterInput()
ln = Line(StartPoint=start_line_1, EndPoint=B)
ln_2 = Line(StartPoint=A, EndPoint=B_2)
N = ClusterInput()
divide = DivideCurve(Curve=ln, Count=expr("x-1", N), Kinks=False)  # -> Points, Tangents, Parameters
divide_2 = DivideCurve(Curve=ln_2, Count=expr("x-1", N), Kinks=False)  # -> Points, Tangents, Parameters
ln_3 = Line(StartPoint=divide.Points, EndPoint=divide_2.Points)
L = ClusterOutput(ln_3)
